# Grasshopper definition URSUS_sample.gh (Grasshopper 1.0.8)
# plug-ins: Moonlight

moonlight = Moonlight(Mode=invert(False))
dataset = ValueList({"월평균 소득", "상주인구", "대중교통 총 승차 승객 수(일일 평균)"}, selected="월평균 소득")
ursus_solver = CSharpScript(vworldKey="2F23FA9B-2FB7-30B4-9335-A9D15732985F", dataseoulKey="69785956756272693534507159576d", dataSet=dataset)  # -> out, legalCodes, names, geometries, centroids, areas, values, unionBoundary; inputs vworldKey: String, dataseoulKey: String, dataSet: list of String
# ---------- ursus_solver: C# ----------
#r "C:\Users\brian\AppData\Roaming\Grasshopper\Libraries\URSUS.dll"
// Grasshopper Script Component — URSUSSolver wrapper
// URSUS.dll 참조 후 URSUSSolver.Run()을 호출해 SolverResult를 GH 와이어로 출력한다.
//
// 입력 파라미터 (GH 컴포넌트에서 +로 추가):
//   vworldKey  string         VWorld API 키
//   seoulKey   string         서울 열린데이터 API 키
//   dataSet    List<string>   사용할 데이터셋 (Value List 체크리스트로 연결)
//
//   Value List 항목 설정 (쌍따옴표 없이 값 입력):
//     월평균 소득
//     상주인구
//     대중교통 총 승차 승객 수(일일 평균)
//     (생활인구는 보류)
//
// 출력 파라미터:
//   legalCodes      List<string>   법정동 코드
//   names           List<string>   법정동 이름
//   geometries      List<Curve>    법정동 경계 PolylineCurve
//   centroids       List<Point3d>  법정동 중심점
//   areas           List<double>   법정동 면적 (m²)
//   values          List<double>   선택 데이터셋 weighted overlay 값 (0~1 정규화)
//   unionBoundary   Curve          전체 외곽선

#region Usings
using System;
using System.Collections.Generic;
using Rhino.Geometry;
using Grasshopper;
using Grasshopper.Kernel;
using Grasshopper.Kernel.Data;
using Grasshopper.Kernel.Types;
using URSUS;
#endregion

public class Script_Instance : GH_ScriptInstance
{
    private void RunScript(
		string vworldKey,
		string dataseoulKey,
		List<string> dataSet,
		ref object legalCodes,
		ref object names,
		ref object geometries,
		ref object centroids,
		ref object areas,
		ref object values,
		ref object unionBoundary)
    {
        try
        {
            if (string.IsNullOrEmpty(vworldKey) || string.IsNullOrEmpty(dataseoulKey))
            { AddRuntimeMessage(GH_RuntimeMessageLevel.Warning, "API 키가 비어 있습니다."); return; }
            if (dataSet == null || dataSet.Count == 0)
            { AddRuntimeMessage(GH_RuntimeMessageLevel.Warning, "데이터셋을 하나 이상 선택하세요."); return; }
            Print($"[DEBUG] dataSet: [{string.Join(", ", dataSet)}]");
            var solver = new URSUSSolver(vworldKey, dataseoulKey);
            SolverResult result = solver.Run(dataSet);

            legalCodes    = result.LegalCodes;
            names         = result.Names;
            geometries    = result.Geometries;
            centroids     = result.Centroids;
            areas         = result.Areas;
            values        = result.Values;
            unionBoundary = result.UnionBoundary;

            Print($"[Solver] 완료: {result.LegalCodes.Count}개 법정동, 데이터셋: {string.Join(", ", dataSet)}");
        }
        catch (Exception ex)
        {
            Print($"[ERR] {ex.GetType().Name}: {ex.Message}");
            AddRuntimeMessage(GH_RuntimeMessageLevel.Error, ex.Message);
        }
    }
}
# ---------- end ursus_solver ----------
crv = Curve(ursus_solver.geometries)
ursus_visualizer = CSharpScript(
    boundary=ursus_solver.unionBoundary,
    centroids=ursus_solver.centroids,
    values=ursus_solver.values,
    power=Slider(2.5, range=0..10),
    heightRatio=Slider(0.5, range=0..1),
    colorStyle=Slider(3, range=0..6))  # -> out, mesh, flatMesh, minVal, maxVal, legendMesh, legendDots; inputs boundary: Curve, centroids: list of Point3d, values: list of Double, resolution: Double, power: Double, heightScale: Double, heightRatio: Double, legendSteps: Int32, colorStyle: Int32, colorLow: Color, colorHigh: Color
# ---------- ursus_visualizer: C# ----------
#r "C:\Users\brian\AppData\Roaming\Grasshopper\Libraries\URSUS.dll"

// Grasshopper Script Component — IDWVisualizer wrapper
// URSUS.dll 참조 후 IDWVisualizer.Build()를 호출해 VisualizerResult를 GH 와이어로 출력한다.
//
// GH Script 컴포넌트 상단에 다음 참조 추가:
//   #r "URSUS.dll"
//
// 입력 파라미터:
//   boundary        Curve          SolverResult.UnionBoundary
//   centroids       List<Point3d>  SolverResult.Centroids
//   values          List<double>   SolverResult.AvgIncomes
//   resolution      double         Mesh 최대 엣지 길이 (기본 100.0)
//   power           double         IDW 지수 p (기본 3.0)
//   heightScale     double         Z 높이 배율 (기본 0.5)
//   heightRatio     double         Z 최대 높이 = bboxWidth × heightRatio (기본 0.25)
//   legendSteps     int            범례 단계 수 (기본 8)
//   colorStyle      int            0=Custom 1=BlueRed 2=Heatmap 3=Spectral 4=Viridis 5=Diverging 6=Grayscale
//   colorLow        Color          colorStyle=0 최솟값 색상
//   colorHigh       Color          colorStyle=0 최댓값 색상
//
// 출력 파라미터:
//   mesh            Mesh           Z 변위 + 컬러 메시
//   flatMesh        Mesh           Z=0 컬러 메시 (지도 오버레이용)
//   minVal          double         범례 최솟값
//   maxVal          double         범례 최댓값
//   legendMesh      Mesh           범례 그라디언트 바
//   legendDots      List<TextDot>  범례 값 레이블

#region Usings
using System;
using System.Collections.Generic;
using System.Drawing;
using Rhino.Geometry;
using Grasshopper;
using Grasshopper.Kernel;
using Grasshopper.Kernel.Data;
using Grasshopper.Kernel.Types;
using URSUS.Visualization;
#endregion

public class Script_Instance : GH_ScriptInstance
{
    private void RunScript(
		Curve boundary,
		List<Point3d> centroids,
		List<double> values,
		double resolution,
		double power,
		double heightScale,
		double heightRatio,
		int legendSteps,
		int colorStyle,
		Color colorLow,
		Color colorHigh,
		ref object mesh,
		ref object flatMesh,
		ref object minVal,
		ref object maxVal,
		ref object legendMesh,
		ref object legendDots)
    {
        try
        {
            if (boundary == null)
            { AddRuntimeMessage(GH_RuntimeMessageLevel.Warning, "boundary가 null입니다."); return; }
            if (centroids == null || centroids.Count == 0)
            { AddRuntimeMessage(GH_RuntimeMessageLevel.Warning, "centroids가 비어 있습니다."); return; }
            if (values == null || values.Count == 0)
            { AddRuntimeMessage(GH_RuntimeMessageLevel.Warning, "values가 비어 있습니다."); return; }

            // 기본값 처리
            if (resolution   <= 0) resolution   = 100.0;
            if (power        <= 0) power        = 2.5;
            if (heightScale  <= 0) heightScale  = 0.5;
            if (heightRatio  <= 0) heightRatio  = 0.5;
            if (legendSteps  <= 1) legendSteps  = 8;
            if (colorLow.A   == 0) colorLow     = Color.FromArgb(44,  123, 182);
            if (colorHigh.A  == 0) colorHigh    = Color.FromArgb(215,  25,  28);

            var visualizer = new IDWVisualizer(
                centroids, values,
                resolution, power, heightScale,
                heightRatio, legendSteps, colorStyle,
                colorLow, colorHigh);

            VisualizerResult result = visualizer.Build(boundary);

            mesh       = result.Mesh;
            flatMesh   = result.FlatMesh;
            minVal     = result.MinVal;
            maxVal     = result.MaxVal;
            legendMesh = result.LegendMesh;
            legendDots = result.LegendDots;

            Print($"[Visualizer] 완료: Mesh Verts={result.Mesh.Vertices.Count}");
        }
        catch (Exception ex)
        {
            Print($"[ERR] {ex.GetType().Name}: {ex.Message}");
            AddRuntimeMessage(GH_RuntimeMessageLevel.Error, ex.Message);
        }
    }
}
# ---------- end ursus_visualizer ----------
mesh = Mesh(ursus_visualizer.mesh)
mesh_2 = Mesh(ursus_visualizer.flatMesh)
mesh_3 = Mesh(ursus_visualizer.legendMesh)
