# Grasshopper definition unnamed.ghx (Grasshopper 1.0.8)
# plug-ins: Moonlight

moonlight = Moonlight(Mode=invert(False))
c_script = CSharpScript(vworldKey="2F23FA9B-2FB7-30B4-9335-A9D15732985F", seoulKey="69785956756272693534507159576d")  # -> out, legalCodes, names, geometries, centroids, areas, avgIncomes, unionBoundary; inputs vworldKey: String, seoulKey: String
# ---------- c_script: C# ----------
#r "C:\Users\brian\AppData\Roaming\Grasshopper\Libraries\URSUS.dll"
// Grasshopper Script Component — URSUSSolver wrapper
// URSUS.dll 참조 후 URSUSSolver.Run()을 호출해 SolverResult를 GH 와이어로 출력한다.
//
// GH Script 컴포넌트 상단에 다음 참조 추가:
//   #r "\\wsl.localhost\Ubuntu\home\keonchae\URSUS\bin\URSUS.dll"
//
// 입력 파라미터:
//   vworldKey       string   VWorld API 키
//   seoulKey        string   서울 열린데이터 API 키
//   address1        string   BBOX 시작 주소
//   address2        string   BBOX 끝 주소
//   mappingJsonPath string   adstrd_legald_mapping.json 경로 (캐시도 같은 폴더 자동 사용)
//
// 출력 파라미터:
//   legalCodes      List<string>   법정동 코드
//   names           List<string>   법정동 이름
//   geometries      List<Curve>    법정동 경계 PolylineCurve
//   centroids       List<Point3d>  법정동 중심점
//   areas           List<double>   법정동 면적 (m²)
//   avgIncomes      List<double>   법정동 기준 월 평균 소득
//   unionBoundary   Curve          전체 외곽선

#region Usings
using System;
using System.Collections.Generic;
using Rhino.Geometry;
using Grasshopper;
using Grasshopper.Kernel;
using Grasshopper.Kernel.Data;
using Grasshopper.Kernel.Types;
using URSUS;
#endregion

public class Script_Instance : GH_ScriptInstance
{
    private void RunScript(
		string vworldKey,
		string seoulKey,
		ref object legalCodes,
		ref object names,
		ref object geometries,
		ref object centroids,
		ref object areas,
		ref object avgIncomes,
		ref object unionBoundary)
    {
        try
        {
            if (string.IsNullOrEmpty(vworldKey) || string.IsNullOrEmpty(seoulKey))
            { AddRuntimeMessage(GH_RuntimeMessageLevel.Warning, "API 키가 비어 있습니다."); return; }
            if (string.IsNullOrEmpty(address1) || string.IsNullOrEmpty(address2))
            { AddRuntimeMessage(GH_RuntimeMessageLevel.Warning, "주소가 비어 있습니다."); return; }
            if (string.IsNullOrEmpty(mappingJsonPath))
            { AddRuntimeMessage(GH_RuntimeMessageLevel.Warning, "mappingJsonPath가 비어 있습니다."); return; }

            var solver = new URSUSSolver(vworldKey, seoulKey, mappingJsonPath);
            SolverResult result = solver.Run(address1, address2);

            legalCodes    = result.LegalCodes;
            names         = result.Names;
            geometries    = result.Geometries;
            centroids     = result.Centroids;
            areas         = result.Areas;
            avgIncomes    = result.AvgIncomes;
            unionBoundary = result.UnionBoundary;

            Print($"[Solver] 완료: {result.LegalCodes.Count}개 법정동");
        }
        catch (Exception ex)
        {
            Print($"[ERR] {ex.GetType().Name}: {ex.Message}");
            AddRuntimeMessage(GH_RuntimeMessageLevel.Error, ex.Message);
        }
    }
}
# ---------- end c_script ----------
pt = Point(c_script.centroids)
crv = Curve(c_script.unionBoundary)
c_script_2 = CSharpScript(
    boundary=c_script.unionBoundary,
    centroids=c_script.centroids,
    values=c_script.avgIncomes,
    heightRatio=Slider(0.5, range=0..1),
    colorStyle=Slider(4, range=0..6))  # -> out, mesh, flatMesh, minVal, maxVal, legendMesh, legendDots; inputs boundary: Curve, centroids: list of Point3d, values: list of Double, resolution: Double, power: Double, heightScale: Double, edgeFalloff: Double, heightRatio: Double, legendSteps: Int32, colorStyle: Int32, colorLow: Color, colorHigh: Color
# ---------- c_script_2: C# ----------
#r "C:\Users\<이름>\AppData\Roaming\Grasshopper\Libraries\URSUS.dll"

#region Usings
using System;
using System.Collections.Generic;
using System.Drawing;
using Rhino.Geometry;
using Grasshopper;
using Grasshopper.Kernel;
using Grasshopper.Kernel.Data;
using Grasshopper.Kernel.Types;
using URSUS.Visualization;
#endregion

public class Script_Instance : GH_ScriptInstance
{
    private void RunScript(
		Curve boundary,
		List<Point3d> centroids,
		List<double> values,
		double resolution,
		double power,
		double heightScale,
		double edgeFalloff,
		double heightRatio,
		int legendSteps,
		int colorStyle,
		Color colorLow,
		Color colorHigh,
		ref object mesh,
		ref object flatMesh,
		ref object minVal,
		ref object maxVal,
		ref object legendMesh,
		ref object legendDots)
    {
        try
        {
            if (boundary == null)
            { AddRuntimeMessage(GH_RuntimeMessageLevel.Warning, "boundary가 null입니다."); return; }
            if (centroids == null || centroids.Count == 0)
            { AddRuntimeMessage(GH_RuntimeMessageLevel.Warning, "centroids가 비어 있습니다."); return; }
            if (values == null || values.Count == 0)
            { AddRuntimeMessage(GH_RuntimeMessageLevel.Warning, "values가 비어 있습니다."); return; }

            if (resolution   <= 0) resolution   = 100.0;
            if (power        <= 0) power        = 3.0;
            if (heightScale  <= 0) heightScale  = 0.5;
            if (edgeFalloff  <= 0) edgeFalloff  = 2.0;
            if (heightRatio  <= 0) heightRatio  = 0.25;
            if (legendSteps  <= 1) legendSteps  = 8;
            if (colorLow.A   == 0) colorLow     = Color.FromArgb(44,  123, 182);
            if (colorHigh.A  == 0) colorHigh    = Color.FromArgb(215,  25,  28);

            var visualizer = new IDWVisualizer(
                centroids, values,
                resolution, power, heightScale,
                edgeFalloff, heightRatio,
                legendSteps, colorStyle,
                colorLow, colorHigh);

            VisualizerResult result = visualizer.Build(boundary);

            mesh       = result.Mesh;
            flatMesh   = result.FlatMesh;
            minVal     = result.MinVal;
            maxVal     = result.MaxVal;
            legendMesh = result.LegendMesh;
            legendDots = result.LegendDots;

            Print($"[Visualizer] 완료: Mesh Verts={result.Mesh.Vertices.Count}");
        }
        catch (Exception ex)
        {
            Print($"[ERR] {ex.GetType().Name}: {ex.Message}");
            AddRuntimeMessage(GH_RuntimeMessageLevel.Error, ex.Message);
        }
    }
}
# ---------- end c_script_2 ----------
mesh = Mesh(c_script_2.mesh)
mesh_2 = Mesh(c_script_2.flatMesh)
mesh_3 = Mesh(c_script_2.legendMesh)
pt_2 = Point(c_script_2.legendDots)
